# Grasshopper definition GD.gh (Grasshopper 1.0.8)
# plug-ins: KohonenMapper, GH_DesignMate

maxheight = Slider(80, range=0..100)

roofgardenbool = Slider(0, range=0..1)
numfloors = Slider(7, range=1..10)
facadetype = Slider(2, range=0..4)
setback = Slider(5, range=0..8)

numfloors_2 = Slider(4, range=1..10)
facadetype_2 = Slider(0, range=0..4)
setback_2 = Slider(1, range=0..8)
roofgardenbool_2 = Slider(0, range=0..1)

roofgardenbool_3 = Slider(1, range=0..1)
numfloors_3 = Slider(5, range=1..10)
setback_3 = Slider(3, range=0..8)
facadetype_3 = Slider(1, range=0..4)

roofgardenbool_4 = Slider(0, range=0..1)
numfloors_4 = Slider(10, range=1..10)
facadetype_4 = Slider(3, range=0..4)
setback_4 = Slider(3, range=0..8)

# ---- group: Last floor geometry
brep = Brep(<brep referenced from the Rhino model>)
brep_2 = Brep([<brep referenced from the Rhino model> x2])
brep_3 = Brep([<brep referenced from the Rhino model> x60])
brep_4 = Brep(<brep referenced from the Rhino model>)
brep_5 = Brep([<brep referenced from the Rhino model> x51])

# ----
floormaker = CreateFloors(FacadePlaceholder=brep, Core=brep_2, Columns=brep_3, Slabs=brep_4)
c_script = CSharpScript(
    data=[numfloors_2, setback_2, facadetype_2, roofgardenbool_2, numfloors_3, setback_3, facadetype_3, roofgardenbool_3, numfloors, setback, facadetype, roofgardenbool, numfloors_4, setback_4, facadetype_4, roofgardenbool_4],
    numFeatures=Slider(4, range=0..10))  # -> out, a; inputs data: list of Double, numFeatures: Int32
# ---------- c_script: C# ----------
// Grasshopper Script Instance
#region Usings
using System;
using System.Linq;
using System.Collections;
using System.Collections.Generic;
using System.Drawing;

using Rhino;
using Rhino.Geometry;

using Grasshopper;
using Grasshopper.Kernel;
using Grasshopper.Kernel.Data;
using Grasshopper.Kernel.Types;
#endregion

public class Script_Instance : GH_ScriptInstance
{
    #region Notes
    /* 
      Members:
        RhinoDoc RhinoDocument
        GH_Document GrasshopperDocument
        IGH_Component Component
        int Iteration

      Methods (Virtual & overridable):
        Print(string text)
        Print(string format, params object[] args)
        Reflect(object obj)
        Reflect(object obj, string method_name)
    */
    #endregion

    private void RunScript(List<double> data, int numFeatures, ref object a)
    {
        var tree = new DataTree<double>();
        GH_Path path;
        int legge = data.Count / numFeatures;
        int counter = 0;

        for (int i = 0; i < legge; i++)
        {
            path = new GH_Path(i);
            for (int j = 0; j < numFeatures; j++)
            {
                tree.Add(data[counter], path);
                counter++;
            }
        }
        a = tree;
    }
}
# ---------- end c_script ----------

# ---- group: 1. Set to false
toggle = BooleanToggle(False)

# ----
# to update the inputs for generation:
# - disable all components after this group
# - toggle to true and then back to false
# - enable timer for a few seconds and then disable it
# - enable the components after this group
number_slider = Slider(150, range=0..200)
kohonen_map = KohonenMap(
    Reset=toggle,
    XMap=Slider(5, range=0..100),
    YMap=Slider(5, range=0..100),
    Space=number_slider,
    Inputs=c_script.a,
    WinLearn="0.95",
    Learn="0.9",
    WinLearnDecay="0.999",
    LearnDecay="0.998",
    NeighDecay=0.99,
    NeighRad=Slider(0.6, range=0..1),
    Seed=Slider(61, range=0..100))  # -> Coverged, Counter, Locations, Synaptics, Neigh, InputLocations

# ---- group: check data structure
panel = Panel(c_script.a)

# ---- group: 2. Enable timer
timer = Timer(Interval=10, TimerInterval=10, Target=kohonen_map)  # disabled

# ----
bool = Boolean(roofgardenbool_2)
panel_2 = Panel(bool)
pt = Point(kohonen_map.Locations)
panel_3 = Panel(kohonen_map.Synaptics)
item = ListItem(List=kohonen_map.Synaptics, Index=0, Wrap=True)  # -> Item, Item1, Item2, Item3
round = Round(Number=item.Item)  # -> Nearest, Floor, Ceiling
round_2 = Round(Number=item.Item1)  # -> Nearest, Floor, Ceiling
round_3 = Round(Number=item.Item2)  # -> Nearest, Floor, Ceiling
round_4 = Round(Number=item.Item3)  # -> Nearest, Floor, Ceiling
panel_4 = Panel(round.Nearest)
generategeomcomp = GenerateGeomComp(
    NumberOfFloors=round.Floor,
    SetbackM=round_2.Floor,
    FacadeType=round_3.Floor,
    AddRoofGarden=round_4.Floor,
    FloorList=floormaker,
    FtF=Slider(4, range=0..10),
    MaxHeight=maxheight)  # -> Columns, Slabs, Core, Beams
vec = Vector(kohonen_map.Locations)
geo = Geometry([<curve referenced from the Rhino model>, <brep referenced from the Rhino model> x4, <curve referenced from the Rhino model>, <brep referenced from the Rhino model> x3, <curve referenced from the Rhino model> x5, <brep referenced from the Rhino model>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])

# ----
# move only for internal demonstration
move = Move(Geometry=geo, Motion=vec)  # -> Geometry, Transform

move_2 = Move(Geometry=generategeomcomp.Columns, Motion=vec)  # -> Geometry, Transform
move_3 = Move(Geometry=generategeomcomp.Slabs, Motion=vec)  # -> Geometry, Transform
move_4 = Move(Geometry=generategeomcomp.Beams, Motion=vec)  # -> Geometry, Transform

preview = CustomPreview(Geometry=move.Geometry, Material=ColourSwatch(SwatchColor=RGB(133, 133, 133)))
preview_2 = CustomPreview(Geometry=move_2.Geometry, Material=ColourSwatch(SwatchColor=RGB(168, 61, 61)))
preview_3 = CustomPreview(Geometry=move_3.Geometry, Material=ColourSwatch(SwatchColor=RGB(61, 159, 168)))
preview_4 = CustomPreview(Geometry=move_4.Geometry, Material=ColourSwatch(SwatchColor=RGB(168, 165, 61)))
