# Grasshopper definition DesignMate.gh (Grasshopper 1.0.8)
# plug-ins: RhinoCodePluginGH, treesloth01, KohonenMapper, GH_DesignMate

maxheight = Slider(80, range=0..100)

roofgardenbool = Slider(0, range=0..1)
numfloors = Slider(5, range=1..10)
facadetype = Slider(2, range=0..4)
setback = Slider(5, range=0..8)

numfloors_2 = Slider(1, range=1..10)
facadetype_2 = Slider(0, range=0..4)
setback_2 = Slider(1, range=0..8)
roofgardenbool_2 = Slider(0, range=0..1)

roofgardenbool_3 = Slider(1, range=0..1)
numfloors_3 = Slider(3, range=1..10)
setback_3 = Slider(3, range=0..8)
facadetype_3 = Slider(1, range=0..4)

roofgardenbool_4 = Slider(0, range=0..1)
numfloors_4 = Slider(10, range=1..10)
facadetype_4 = Slider(3, range=0..4)
setback_4 = Slider(3, range=0..8)

# ---- group: Last floor geometry
brep = Brep(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)
brep_2 = Brep([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])
brep_3 = Brep([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])
brep_4 = Brep(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)
brep_5 = Brep([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])

# ----
slabs = Brep([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])
columns = Brep([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])  # disabled
vertical_circulation = Brep([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])  # disabled
ground_plane = Brep(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)  # disabled
floormaker = CreateFloors(FacadePlaceholder=brep, Core=brep_2, Columns=brep_3, Slabs=brep_4, Beams=brep_5)
mesh = Mesh(columns)  # disabled
mesh_2 = Mesh(ground_plane)  # disabled
mesh_3 = Mesh(vertical_circulation)  # disabled
mesh_4 = Mesh(slabs)
swatch = ColourSwatch(SwatchColor=RGB(93, 75, 69))  # disabled
swatch_2 = ColourSwatch(SwatchColor=RGB(244, 240, 248))  # disabled
c_script = CSharpScript(
    data=[numfloors_2, setback_2, facadetype_2, roofgardenbool_2, numfloors_3, setback_3, facadetype_3, roofgardenbool_3, numfloors, setback, facadetype, roofgardenbool, numfloors_4, setback_4, facadetype_4, roofgardenbool_4],
    numFeatures=Slider(4, range=0..10))  # -> out, a; inputs data: list of Double, numFeatures: Int32
# ---------- c_script: C# ----------
// Grasshopper Script Instance
#region Usings
using System;
using System.Linq;
using System.Collections;
using System.Collections.Generic;
using System.Drawing;

using Rhino;
using Rhino.Geometry;

using Grasshopper;
using Grasshopper.Kernel;
using Grasshopper.Kernel.Data;
using Grasshopper.Kernel.Types;
#endregion

public class Script_Instance : GH_ScriptInstance
{
    #region Notes
    /* 
      Members:
        RhinoDoc RhinoDocument
        GH_Document GrasshopperDocument
        IGH_Component Component
        int Iteration

      Methods (Virtual & overridable):
        Print(string text)
        Print(string format, params object[] args)
        Reflect(object obj)
        Reflect(object obj, string method_name)
    */
    #endregion

    private void RunScript(List<double> data, int numFeatures, ref object a)
    {
        var tree = new DataTree<double>();
        GH_Path path;
        int legge = data.Count / numFeatures;
        int counter = 0;

        for (int i = 0; i < legge; i++)
        {
            path = new GH_Path(i);
            for (int j = 0; j < numFeatures; j++)
            {
                tree.Add(data[counter], path);
                counter++;
            }
        }
        a = tree;
    }
}
# ---------- end c_script ----------
swatch_3 = ColourSwatch(SwatchColor=RGB(21, 167, 136))  # disabled
X = UnitX(Factor=expr("-x", 1))
Y = UnitY(Factor=1)
xz = XZPlane(Origin=Point(0, 0, 0))
mcol = MeshColours(Mesh=mesh_4, Colours=ColourSwatch(SwatchColor=RGB(38, 149, 178)))
mcol_2 = MeshColours(Mesh=mesh, Colours=swatch)  # disabled
mcol_3 = MeshColours(Mesh=mesh_3, Colours=swatch_3)  # disabled
mcol_4 = MeshColours(Mesh=mesh_2, Colours=swatch_2)  # disabled

# ---- group: 1. Set to false
toggle = BooleanToggle(False)

# ----
# to update the inputs for generation:
# - disable all components after this group
# - toggle to true and then back to false
# - enable timer for a few seconds and then disable it
# - enable the components after this group
number_slider = Slider(150, range=0..200)
kohonen_map = KohonenMap(
    Reset=toggle,
    XMap=Slider(3, range=0..100),
    YMap=Slider(4, range=0..100),
    Space=number_slider,
    Inputs=c_script.a,
    WinLearn="0.95",
    Learn="0.9",
    WinLearnDecay="0.999",
    LearnDecay="0.998",
    NeighDecay=0.99,
    NeighRad=Slider(0.6, range=0..1),
    Seed=Slider(61, range=0..100))  # -> Coverged, Counter, Locations, Synaptics, Neigh, InputLocations; disabled

pl = ConstructPlane(Origin=Point(0, 0, 0), XAxis=X, YAxis=Y)

# ---- group: check data structure
panel = Panel(c_script.a)

# ----
mjoin = MeshJoin(Meshes=mcol)
mjoin_2 = MeshJoin(Meshes=mcol_4)  # disabled
mjoin_3 = MeshJoin(Meshes=mcol_2)  # disabled
mjoin_4 = MeshJoin(Meshes=mcol_3)  # disabled
orient = Orient(Geometry=mjoin, Source=pl, Target=xz)  # -> Geometry, Transform
orient_2 = Orient(Geometry=mjoin_3, Source=pl, Target=xz)  # -> Geometry, Transform; disabled
orient_3 = Orient(Geometry=mjoin_2, Source=pl, Target=xz)  # -> Geometry, Transform; disabled
orient_4 = Orient(Geometry=mjoin_4, Source=pl, Target=xz)  # -> Geometry, Transform; disabled

# ---- group: 2. Enable timer
timer = Timer(Interval=10, TimerInterval=10, Target=kohonen_map)  # disabled

# ----
bool = Boolean(roofgardenbool_2)
c_script_2 = CSharpScript(mesh=orient.Geometry)  # -> base64Draco; inputs mesh: Mesh
# ---------- c_script_2: C# ----------
    var options = new Rhino.FileIO.DracoCompressionOptions();
    options.CompressionLevel = 5;
    options.IncludeTextureCoordinates = true;
    options.IncludeVertexColors = true;

    var compressed = Rhino.FileIO.DracoCompression.Compress(mesh, options);
    base64Draco = compressed.ToBase64String();
# ---------- end c_script_2 ----------
c_script_3 = CSharpScript(mesh=orient_2.Geometry)  # -> base64Draco; inputs mesh: Mesh; disabled; same code as c_script_2
c_script_4 = CSharpScript(mesh=orient_4.Geometry)  # -> base64Draco; inputs mesh: Mesh; disabled; same code as c_script_2
c_script_5 = CSharpScript(mesh=orient_3.Geometry)  # -> base64Draco; inputs mesh: Mesh; disabled; same code as c_script_2
panel_2 = Panel(bool)

# ---- group: RH_OUT:Mesh_Slab
txt = Text(c_script_2)

# ----
panel_3 = Panel(kohonen_map.Synaptics)  # disabled
data = Data(Tree({0;0}: [11.28013289, 6.605229723, 3.083321304, -0.409640316], {0;1}: [15.17134231, 8.553374844, 4.77066311, 0.7809449207], {0;2}: [11.40662945, 6.511766365, 3.397797345, 0.4719483825], {0;3}: [7.321956774, 4.7425771, 1.967583211, 0.3195570296], {1;0}: [15.65821362, 8.631518268, 4.632552953, -1.282403347], {1;1}: [15.46447046, 9.112626582, 4.871678531, 0.007509447475], {1;2}: [15.25164081, 8.759688871, 4.51291374, -0.2301284022], {1;3}: [8.204649646, 5.195940001, 2.168012961, 0.05784368718], {2;0}: [10.77321143, 6.723593221, 2.581995048, 0.1030896134], {2;1}: [15.44664077, 8.302270336, 3.702557174, -0.375902364], {2;2}: [11.41875753, 6.532907933, 3.792265852, 0.4049428198], {2;3}: [7.527053476, 4.475520059, 2.367294828, 0.1854787801]))
item = ListItem(List=data, Index=0, Wrap=True)  # -> Item, Item1, Item2, Item3
round = Round(Number=item.Item)  # -> Nearest, Floor, Ceiling
round_2 = Round(Number=item.Item1)  # -> Nearest, Floor, Ceiling
round_3 = Round(Number=item.Item2)  # -> Nearest, Floor, Ceiling
round_4 = Round(Number=item.Item3)  # -> Nearest, Floor, Ceiling
generategeomcomp = GenerateGeomComp(
    NumberOfFloors=round.Floor,
    SetbackM=round_2.Floor,
    FacadeType=round_3.Floor,
    AddRoofGarden=round_4.Floor,
    FloorList=floormaker,
    FtF=Slider(4, range=0..10),
    MaxHeight=maxheight)  # -> FacadePlaceholder, Columns, Slabs, Core, Beams
vec = Vector(kohonen_map.Locations)  # disabled
geo = Geometry([<curve referenced from the Rhino model>, <brep referenced from the Rhino model> x7, <curve referenced from the Rhino model> x3, <brep referenced from the Rhino model> x4, <curve referenced from the Rhino model> x3, <brep referenced from the Rhino model> x2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])  # disabled
brep_6 = Brep([generategeomcomp.FacadePlaceholder, generategeomcomp.Columns, generategeomcomp.Slabs, generategeomcomp.Core, generategeomcomp.Beams])

# ----
# move only for internal demonstration
move = Move(Geometry=brep_6, Motion=vec)  # -> Geometry, Transform; disabled
move_2 = Move(Geometry=geo, Motion=vec)  # -> Geometry, Transform; disabled

brep_7 = Brep(generategeomcomp.FacadePlaceholder)
brep_8 = Brep(generategeomcomp.Columns)
brep_9 = Brep(generategeomcomp.Slabs)
brep_10 = Brep(generategeomcomp.Core)
renumber = RenumberPaths(Data=brep_7)
renumber_2 = RenumberPaths(Data=brep_8)
brep_11 = Brep(generategeomcomp.Beams)
renumber_3 = RenumberPaths(Data=brep_9)
branch = TreeBranch(Tree=renumber, Path="0", MaintainPaths=True)
renumber_4 = RenumberPaths(Data=brep_10)
branch_2 = TreeBranch(Tree=renumber, Path="1", MaintainPaths=True)
branch_3 = TreeBranch(Tree=renumber, Path="2", MaintainPaths=True)
branch_4 = TreeBranch(Tree=renumber, Path="3", MaintainPaths=True)
branch_5 = TreeBranch(Tree=renumber, Path="4", MaintainPaths=True)
branch_6 = TreeBranch(Tree=renumber, Path="5", MaintainPaths=True)
branch_7 = TreeBranch(Tree=renumber, Path="6", MaintainPaths=True)
branch_8 = TreeBranch(Tree=renumber, Path="8", MaintainPaths=True)
branch_9 = TreeBranch(Tree=renumber, Path="7", MaintainPaths=True)
branch_10 = TreeBranch(Tree=renumber, Path="9", MaintainPaths=True)
branch_11 = TreeBranch(Tree=renumber_2, Path="0", MaintainPaths=True)
branch_12 = TreeBranch(Tree=renumber, Path="10", MaintainPaths=True)
branch_13 = TreeBranch(Tree=renumber, Path="11", MaintainPaths=True)
branch_14 = TreeBranch(Tree=renumber_2, Path="1", MaintainPaths=True)
branch_15 = TreeBranch(Tree=renumber_2, Path="2", MaintainPaths=True)
branch_16 = TreeBranch(Tree=renumber_2, Path="3", MaintainPaths=True)
branch_17 = TreeBranch(Tree=renumber_2, Path="4", MaintainPaths=True)
branch_18 = TreeBranch(Tree=renumber_2, Path="5", MaintainPaths=True)
branch_19 = TreeBranch(Tree=renumber_2, Path="6", MaintainPaths=True)
branch_20 = TreeBranch(Tree=renumber_2, Path="8", MaintainPaths=True)
branch_21 = TreeBranch(Tree=renumber_2, Path="7", MaintainPaths=True)
branch_22 = TreeBranch(Tree=renumber_2, Path="9", MaintainPaths=True)
renumber_5 = RenumberPaths(Data=brep_11)
branch_23 = TreeBranch(Tree=renumber_2, Path="10", MaintainPaths=True)
branch_24 = TreeBranch(Tree=renumber_2, Path="11", MaintainPaths=True)
branch_25 = TreeBranch(Tree=renumber_3, Path="0", MaintainPaths=True)
branch_26 = TreeBranch(Tree=renumber_3, Path="1", MaintainPaths=True)
branch_27 = TreeBranch(Tree=renumber_3, Path="2", MaintainPaths=True)
branch_28 = TreeBranch(Tree=renumber_3, Path="3", MaintainPaths=True)
branch_29 = TreeBranch(Tree=renumber_3, Path="4", MaintainPaths=True)
branch_30 = TreeBranch(Tree=renumber_3, Path="5", MaintainPaths=True)
branch_31 = TreeBranch(Tree=renumber_3, Path="6", MaintainPaths=True)
branch_32 = TreeBranch(Tree=renumber_3, Path="8", MaintainPaths=True)
branch_33 = TreeBranch(Tree=renumber_3, Path="7", MaintainPaths=True)
branch_34 = TreeBranch(Tree=renumber_3, Path="9", MaintainPaths=True)
branch_35 = TreeBranch(Tree=renumber_3, Path="10", MaintainPaths=True)
branch_36 = TreeBranch(Tree=renumber_3, Path="11", MaintainPaths=True)
branch_37 = TreeBranch(Tree=renumber_4, Path="0", MaintainPaths=True)
mesh_5 = Mesh(branch)
branch_38 = TreeBranch(Tree=renumber_4, Path="1", MaintainPaths=True)
branch_39 = TreeBranch(Tree=renumber_4, Path="2", MaintainPaths=True)
branch_40 = TreeBranch(Tree=renumber_4, Path="3", MaintainPaths=True)
branch_41 = TreeBranch(Tree=renumber_4, Path="4", MaintainPaths=True)
branch_42 = TreeBranch(Tree=renumber_4, Path="5", MaintainPaths=True)
mesh_6 = Mesh(branch_2)
mesh_7 = Mesh(branch_4)
mesh_8 = Mesh(branch_5)
mesh_9 = Mesh(branch_3)
branch_43 = TreeBranch(Tree=renumber_4, Path="6", MaintainPaths=True)
mesh_10 = Mesh(branch_9)
mesh_11 = Mesh(branch_7)
branch_44 = TreeBranch(Tree=renumber_4, Path="8", MaintainPaths=True)
mesh_12 = Mesh(branch_6)
mesh_13 = Mesh(branch_8)
branch_45 = TreeBranch(Tree=renumber_4, Path="7", MaintainPaths=True)
mesh_14 = Mesh(branch_11)
branch_46 = TreeBranch(Tree=renumber_4, Path="9", MaintainPaths=True)
mesh_15 = Mesh(branch_10)
mesh_16 = Mesh(branch_12)
mesh_17 = Mesh(branch_14)
branch_47 = TreeBranch(Tree=renumber_4, Path="10", MaintainPaths=True)
branch_48 = TreeBranch(Tree=renumber_4, Path="11", MaintainPaths=True)
mesh_18 = Mesh(branch_13)
mesh_19 = Mesh(branch_15)
mesh_20 = Mesh(branch_16)
mesh_21 = Mesh(branch_17)
mesh_22 = Mesh(branch_18)
mesh_23 = Mesh(branch_19)
mesh_24 = Mesh(branch_20)
mesh_25 = Mesh(branch_22)
mesh_26 = Mesh(branch_21)
mesh_27 = Mesh(branch_23)
branch_49 = TreeBranch(Tree=renumber_5, Path="0", MaintainPaths=True)
branch_50 = TreeBranch(Tree=renumber_5, Path="1", MaintainPaths=True)
branch_51 = TreeBranch(Tree=renumber_5, Path="2", MaintainPaths=True)
mesh_28 = Mesh(branch_24)
branch_52 = TreeBranch(Tree=renumber_5, Path="3", MaintainPaths=True)
branch_53 = TreeBranch(Tree=renumber_5, Path="4", MaintainPaths=True)
branch_54 = TreeBranch(Tree=renumber_5, Path="5", MaintainPaths=True)
branch_55 = TreeBranch(Tree=renumber_5, Path="6", MaintainPaths=True)
branch_56 = TreeBranch(Tree=renumber_5, Path="8", MaintainPaths=True)
mesh_29 = Mesh(branch_25)
branch_57 = TreeBranch(Tree=renumber_5, Path="9", MaintainPaths=True)
branch_58 = TreeBranch(Tree=renumber_5, Path="7", MaintainPaths=True)
branch_59 = TreeBranch(Tree=renumber_5, Path="10", MaintainPaths=True)
branch_60 = TreeBranch(Tree=renumber_5, Path="11", MaintainPaths=True)
mesh_30 = Mesh(branch_26)
mesh_31 = Mesh(branch_28)
mesh_32 = Mesh(branch_30)
mesh_33 = Mesh(branch_31)
mesh_34 = Mesh(branch_27)
mesh_35 = Mesh(branch_29)
mesh_36 = Mesh(branch_33)
mesh_37 = Mesh(branch_32)
mesh_38 = Mesh(branch_34)
mesh_39 = Mesh(branch_35)
mesh_40 = Mesh(branch_36)
mesh_41 = Mesh(branch_37)
mesh_42 = Mesh(branch_38)
mesh_43 = Mesh(branch_39)
mesh_44 = Mesh(branch_43)
mesh_45 = Mesh(branch_40)
mesh_46 = Mesh(branch_41)
mesh_47 = Mesh(branch_45)
mesh_48 = Mesh(branch_42)
mesh_49 = Mesh(branch_44)
mesh_50 = Mesh(branch_46)
mesh_51 = Mesh(branch_47)
mesh_52 = Mesh(branch_48)
mesh_53 = Mesh(branch_49)
mesh_54 = Mesh(branch_50)
mesh_55 = Mesh(branch_53)
mesh_56 = Mesh(branch_52)
mesh_57 = Mesh(branch_51)
mesh_58 = Mesh(branch_54)
mesh_59 = Mesh(branch_55)
mesh_60 = Mesh(branch_58)
mesh_61 = Mesh(branch_56)
mesh_62 = Mesh(branch_57)
orient_5 = Orient(Geometry=mesh_5, Source=pl, Target=xz)  # -> Geometry, Transform
mesh_63 = Mesh(branch_60)
orient_6 = Orient(Geometry=mesh_6, Source=pl, Target=xz)  # -> Geometry, Transform
orient_7 = Orient(Geometry=mesh_9, Source=pl, Target=xz)  # -> Geometry, Transform
mesh_64 = Mesh(branch_59)
orient_8 = Orient(Geometry=mesh_7, Source=pl, Target=xz)  # -> Geometry, Transform
orient_9 = Orient(Geometry=mesh_8, Source=pl, Target=xz)  # -> Geometry, Transform
orient_10 = Orient(Geometry=mesh_12, Source=pl, Target=xz)  # -> Geometry, Transform
orient_11 = Orient(Geometry=mesh_11, Source=pl, Target=xz)  # -> Geometry, Transform
orient_12 = Orient(Geometry=mesh_13, Source=pl, Target=xz)  # -> Geometry, Transform
orient_13 = Orient(Geometry=mesh_10, Source=pl, Target=xz)  # -> Geometry, Transform
orient_14 = Orient(Geometry=mesh_15, Source=pl, Target=xz)  # -> Geometry, Transform
orient_15 = Orient(Geometry=mesh_14, Source=pl, Target=xz)  # -> Geometry, Transform
orient_16 = Orient(Geometry=mesh_16, Source=pl, Target=xz)  # -> Geometry, Transform
orient_17 = Orient(Geometry=mesh_18, Source=pl, Target=xz)  # -> Geometry, Transform
orient_18 = Orient(Geometry=mesh_17, Source=pl, Target=xz)  # -> Geometry, Transform
orient_19 = Orient(Geometry=mesh_19, Source=pl, Target=xz)  # -> Geometry, Transform
orient_20 = Orient(Geometry=mesh_20, Source=pl, Target=xz)  # -> Geometry, Transform
orient_21 = Orient(Geometry=mesh_21, Source=pl, Target=xz)  # -> Geometry, Transform
orient_22 = Orient(Geometry=mesh_22, Source=pl, Target=xz)  # -> Geometry, Transform
orient_23 = Orient(Geometry=mesh_23, Source=pl, Target=xz)  # -> Geometry, Transform
orient_24 = Orient(Geometry=mesh_24, Source=pl, Target=xz)  # -> Geometry, Transform
orient_25 = Orient(Geometry=mesh_26, Source=pl, Target=xz)  # -> Geometry, Transform
orient_26 = Orient(Geometry=mesh_25, Source=pl, Target=xz)  # -> Geometry, Transform
orient_27 = Orient(Geometry=mesh_27, Source=pl, Target=xz)  # -> Geometry, Transform
orient_28 = Orient(Geometry=mesh_28, Source=pl, Target=xz)  # -> Geometry, Transform
orient_29 = Orient(Geometry=mesh_29, Source=pl, Target=xz)  # -> Geometry, Transform
orient_30 = Orient(Geometry=mesh_30, Source=pl, Target=xz)  # -> Geometry, Transform
orient_31 = Orient(Geometry=mesh_34, Source=pl, Target=xz)  # -> Geometry, Transform
orient_32 = Orient(Geometry=mesh_31, Source=pl, Target=xz)  # -> Geometry, Transform
orient_33 = Orient(Geometry=mesh_35, Source=pl, Target=xz)  # -> Geometry, Transform
orient_34 = Orient(Geometry=mesh_32, Source=pl, Target=xz)  # -> Geometry, Transform
orient_35 = Orient(Geometry=mesh_33, Source=pl, Target=xz)  # -> Geometry, Transform
orient_36 = Orient(Geometry=mesh_37, Source=pl, Target=xz)  # -> Geometry, Transform
orient_37 = Orient(Geometry=mesh_36, Source=pl, Target=xz)  # -> Geometry, Transform
orient_38 = Orient(Geometry=mesh_38, Source=pl, Target=xz)  # -> Geometry, Transform
orient_39 = Orient(Geometry=mesh_39, Source=pl, Target=xz)  # -> Geometry, Transform
orient_40 = Orient(Geometry=mesh_40, Source=pl, Target=xz)  # -> Geometry, Transform
mjoin_5 = MeshJoin(Meshes=mesh_5)
orient_41 = Orient(Geometry=mesh_41, Source=pl, Target=xz)  # -> Geometry, Transform
c_script_6 = CSharpScript(mesh=orient_6.Geometry)  # -> base64Draco; inputs mesh: Mesh; same code as c_script_2
c_script_7 = CSharpScript(mesh=orient_5.Geometry)  # -> base64Draco; inputs mesh: Mesh; same code as c_script_2
c_script_8 = CSharpScript(mesh=orient_7.Geometry)  # -> base64Draco; inputs mesh: Mesh; same code as c_script_2
orient_42 = Orient(Geometry=mesh_42, Source=pl, Target=xz)  # -> Geometry, Transform
orient_43 = Orient(Geometry=mesh_43, Source=pl, Target=xz)  # -> Geometry, Transform
c_script_9 = CSharpScript(mesh=orient_10.Geometry)  # -> base64Draco; inputs mesh: Mesh; same code as c_script_2
c_script_10 = CSharpScript(mesh=orient_9.Geometry)  # -> base64Draco; inputs mesh: Mesh; same code as c_script_2
orient_44 = Orient(Geometry=mesh_45, Source=pl, Target=xz)  # -> Geometry, Transform
c_script_11 = CSharpScript(mesh=orient_11.Geometry)  # -> base64Draco; inputs mesh: Mesh; same code as c_script_2
orient_45 = Orient(Geometry=mesh_46, Source=pl, Target=xz)  # -> Geometry, Transform
orient_46 = Orient(Geometry=mesh_48, Source=pl, Target=xz)  # -> Geometry, Transform
c_script_12 = CSharpScript(mesh=orient_8.Geometry)  # -> base64Draco; inputs mesh: Mesh; same code as c_script_2
c_script_13 = CSharpScript(mesh=orient_12.Geometry)  # -> base64Draco; inputs mesh: Mesh; same code as c_script_2
c_script_14 = CSharpScript(mesh=orient_13.Geometry)  # -> base64Draco; inputs mesh: Mesh; same code as c_script_2
orient_47 = Orient(Geometry=mesh_44, Source=pl, Target=xz)  # -> Geometry, Transform
c_script_15 = CSharpScript(mesh=orient_14.Geometry)  # -> base64Draco; inputs mesh: Mesh; same code as c_script_2
c_script_16 = CSharpScript(mesh=orient_15.Geometry)  # -> base64Draco; inputs mesh: Mesh; same code as c_script_2
orient_48 = Orient(Geometry=mesh_49, Source=pl, Target=xz)  # -> Geometry, Transform
orient_49 = Orient(Geometry=mesh_47, Source=pl, Target=xz)  # -> Geometry, Transform
c_script_17 = CSharpScript(mesh=orient_16.Geometry)  # -> base64Draco; inputs mesh: Mesh; same code as c_script_2
c_script_18 = CSharpScript(mesh=orient_17.Geometry)  # -> base64Draco; inputs mesh: Mesh; same code as c_script_2
c_script_19 = CSharpScript(mesh=orient_18.Geometry)  # -> base64Draco; inputs mesh: Mesh; same code as c_script_2
orient_50 = Orient(Geometry=mesh_50, Source=pl, Target=xz)  # -> Geometry, Transform
c_script_20 = CSharpScript(mesh=orient_19.Geometry)  # -> base64Draco; inputs mesh: Mesh; same code as c_script_2
c_script_21 = CSharpScript(mesh=orient_20.Geometry)  # -> base64Draco; inputs mesh: Mesh; same code as c_script_2
orient_51 = Orient(Geometry=mesh_51, Source=pl, Target=xz)  # -> Geometry, Transform
orient_52 = Orient(Geometry=mesh_52, Source=pl, Target=xz)  # -> Geometry, Transform
c_script_22 = CSharpScript(mesh=orient_21.Geometry)  # -> base64Draco; inputs mesh: Mesh; same code as c_script_2
c_script_23 = CSharpScript(mesh=orient_22.Geometry)  # -> base64Draco; inputs mesh: Mesh; same code as c_script_2
c_script_24 = CSharpScript(mesh=orient_23.Geometry)  # -> base64Draco; inputs mesh: Mesh; same code as c_script_2
c_script_25 = CSharpScript(mesh=orient_24.Geometry)  # -> base64Draco; inputs mesh: Mesh; same code as c_script_2
c_script_26 = CSharpScript(mesh=orient_25.Geometry)  # -> base64Draco; inputs mesh: Mesh; same code as c_script_2
c_script_27 = CSharpScript(mesh=orient_26.Geometry)  # -> base64Draco; inputs mesh: Mesh; same code as c_script_2
c_script_28 = CSharpScript(mesh=orient_27.Geometry)  # -> base64Draco; inputs mesh: Mesh; same code as c_script_2
c_script_29 = CSharpScript(mesh=orient_28.Geometry)  # -> base64Draco; inputs mesh: Mesh; same code as c_script_2
orient_53 = Orient(Geometry=mesh_53, Source=pl, Target=xz)  # -> Geometry, Transform
orient_54 = Orient(Geometry=mesh_54, Source=pl, Target=xz)  # -> Geometry, Transform
c_script_30 = CSharpScript(mesh=orient_29.Geometry)  # -> base64Draco; inputs mesh: Mesh; same code as c_script_2
orient_55 = Orient(Geometry=mesh_57, Source=pl, Target=xz)  # -> Geometry, Transform
c_script_31 = CSharpScript(mesh=orient_30.Geometry)  # -> base64Draco; inputs mesh: Mesh; same code as c_script_2
orient_56 = Orient(Geometry=mesh_56, Source=pl, Target=xz)  # -> Geometry, Transform
c_script_32 = CSharpScript(mesh=orient_31.Geometry)  # -> base64Draco; inputs mesh: Mesh; same code as c_script_2
orient_57 = Orient(Geometry=mesh_55, Source=pl, Target=xz)  # -> Geometry, Transform
c_script_33 = CSharpScript(mesh=orient_32.Geometry)  # -> base64Draco; inputs mesh: Mesh; same code as c_script_2
orient_58 = Orient(Geometry=mesh_58, Source=pl, Target=xz)  # -> Geometry, Transform
orient_59 = Orient(Geometry=mesh_59, Source=pl, Target=xz)  # -> Geometry, Transform
c_script_34 = CSharpScript(mesh=orient_33.Geometry)  # -> base64Draco; inputs mesh: Mesh; same code as c_script_2
c_script_35 = CSharpScript(mesh=orient_34.Geometry)  # -> base64Draco; inputs mesh: Mesh; same code as c_script_2
orient_60 = Orient(Geometry=mesh_61, Source=pl, Target=xz)  # -> Geometry, Transform
orient_61 = Orient(Geometry=mesh_60, Source=pl, Target=xz)  # -> Geometry, Transform
c_script_36 = CSharpScript(mesh=orient_35.Geometry)  # -> base64Draco; inputs mesh: Mesh; same code as c_script_2
orient_62 = Orient(Geometry=mesh_62, Source=pl, Target=xz)  # -> Geometry, Transform
c_script_37 = CSharpScript(mesh=orient_36.Geometry)  # -> base64Draco; inputs mesh: Mesh; same code as c_script_2
c_script_38 = CSharpScript(mesh=orient_37.Geometry)  # -> base64Draco; inputs mesh: Mesh; same code as c_script_2
orient_63 = Orient(Geometry=mesh_64, Source=pl, Target=xz)  # -> Geometry, Transform
orient_64 = Orient(Geometry=mesh_63, Source=pl, Target=xz)  # -> Geometry, Transform
c_script_39 = CSharpScript(mesh=orient_38.Geometry)  # -> base64Draco; inputs mesh: Mesh; same code as c_script_2
c_script_40 = CSharpScript(mesh=orient_39.Geometry)  # -> base64Draco; inputs mesh: Mesh; same code as c_script_2
c_script_41 = CSharpScript(mesh=orient_40.Geometry)  # -> base64Draco; inputs mesh: Mesh; same code as c_script_2
c_script_42 = CSharpScript(mesh=orient_41.Geometry)  # -> base64Draco; inputs mesh: Mesh; same code as c_script_2
c_script_43 = CSharpScript(mesh=orient_42.Geometry)  # -> base64Draco; inputs mesh: Mesh; same code as c_script_2
c_script_44 = CSharpScript(mesh=orient_43.Geometry)  # -> base64Draco; inputs mesh: Mesh; same code as c_script_2
c_script_45 = CSharpScript(mesh=orient_44.Geometry)  # -> base64Draco; inputs mesh: Mesh; same code as c_script_2
c_script_46 = CSharpScript(mesh=orient_45.Geometry)  # -> base64Draco; inputs mesh: Mesh; same code as c_script_2
c_script_47 = CSharpScript(mesh=orient_46.Geometry)  # -> base64Draco; inputs mesh: Mesh; same code as c_script_2
c_script_48 = CSharpScript(mesh=orient_47.Geometry)  # -> base64Draco; inputs mesh: Mesh; same code as c_script_2
c_script_49 = CSharpScript(mesh=orient_48.Geometry)  # -> base64Draco; inputs mesh: Mesh; same code as c_script_2
c_script_50 = CSharpScript(mesh=orient_49.Geometry)  # -> base64Draco; inputs mesh: Mesh; same code as c_script_2
c_script_51 = CSharpScript(mesh=orient_50.Geometry)  # -> base64Draco; inputs mesh: Mesh; same code as c_script_2
c_script_52 = CSharpScript(mesh=orient_51.Geometry)  # -> base64Draco; inputs mesh: Mesh; same code as c_script_2
c_script_53 = CSharpScript(mesh=orient_52.Geometry)  # -> base64Draco; inputs mesh: Mesh; same code as c_script_2
c_script_54 = CSharpScript(mesh=orient_53.Geometry)  # -> base64Draco; inputs mesh: Mesh; same code as c_script_2
c_script_55 = CSharpScript(mesh=orient_54.Geometry)  # -> base64Draco; inputs mesh: Mesh; same code as c_script_2
c_script_56 = CSharpScript(mesh=orient_55.Geometry)  # -> base64Draco; inputs mesh: Mesh; same code as c_script_2
c_script_57 = CSharpScript(mesh=orient_56.Geometry)  # -> base64Draco; inputs mesh: Mesh; same code as c_script_2
c_script_58 = CSharpScript(mesh=orient_57.Geometry)  # -> base64Draco; inputs mesh: Mesh; same code as c_script_2
c_script_59 = CSharpScript(mesh=orient_58.Geometry)  # -> base64Draco; inputs mesh: Mesh; same code as c_script_2
c_script_60 = CSharpScript(mesh=orient_59.Geometry)  # -> base64Draco; inputs mesh: Mesh; same code as c_script_2
c_script_61 = CSharpScript(mesh=orient_60.Geometry)  # -> base64Draco; inputs mesh: Mesh; same code as c_script_2
c_script_62 = CSharpScript(mesh=orient_61.Geometry)  # -> base64Draco; inputs mesh: Mesh; same code as c_script_2
c_script_63 = CSharpScript(mesh=orient_62.Geometry)  # -> base64Draco; inputs mesh: Mesh; same code as c_script_2
c_script_64 = CSharpScript(mesh=orient_63.Geometry)  # -> base64Draco; inputs mesh: Mesh; same code as c_script_2
c_script_65 = CSharpScript(mesh=orient_64.Geometry)  # -> base64Draco; inputs mesh: Mesh; same code as c_script_2

# ---- group: RH_OUT:Mesh_Facade0
txt_2 = Text(c_script_7)

# ---- group: RH_OUT:Mesh_Facade1
txt_3 = Text(c_script_6)

# ---- group: RH_OUT:Mesh_Facade2
txt_4 = Text(c_script_8)

# ---- group: RH_OUT:Mesh_Facade3
txt_5 = Text(c_script_12)

# ---- group: RH_OUT:Mesh_Facade4
txt_6 = Text(c_script_10)

# ---- group: RH_OUT:Mesh_Facade5
txt_7 = Text(c_script_9)

# ---- group: RH_OUT:Mesh_Facade6
txt_8 = Text(c_script_11)

# ---- group: RH_OUT:Mesh_Facade8
txt_9 = Text(c_script_13)

# ---- group: RH_OUT:Mesh_Facade7
txt_10 = Text(c_script_14)

# ---- group: RH_OUT:Mesh_Columns0
txt_11 = Text(c_script_16)

# ---- group: RH_OUT:Mesh_Facade9
txt_12 = Text(c_script_15)

# ---- group: RH_OUT:Mesh_Columns1
txt_13 = Text(c_script_19)

# ---- group: RH_OUT:Mesh_Facade10
txt_14 = Text(c_script_17)

# ---- group: RH_OUT:Mesh_Facade11
txt_15 = Text(c_script_18)

# ---- group: RH_OUT:Mesh_Columns2
txt_16 = Text(c_script_20)

# ---- group: RH_OUT:Mesh_Columns3
txt_17 = Text(c_script_21)

# ---- group: RH_OUT:Mesh_Columns4
txt_18 = Text(c_script_22)

# ---- group: RH_OUT:Mesh_Columns5
txt_19 = Text(c_script_23)

# ---- group: RH_OUT:Mesh_Columns6
txt_20 = Text(c_script_24)

# ---- group: RH_OUT:Mesh_Columns7
txt_21 = Text(c_script_26)

# ---- group: RH_OUT:Mesh_Columns8
txt_22 = Text(c_script_25)

# ---- group: RH_OUT:Mesh_Columns9
txt_23 = Text(c_script_27)

# ---- group: RH_OUT:Mesh_Columns10
txt_24 = Text(c_script_28)

# ---- group: RH_OUT:Mesh_Columns11
txt_25 = Text(c_script_29)

# ---- group: RH_OUT:Mesh_Slabs0
txt_26 = Text(c_script_30)

# ---- group: RH_OUT:Mesh_Slabs1
txt_27 = Text(c_script_31)

# ---- group: RH_OUT:Mesh_Slabs2
txt_28 = Text(c_script_32)

# ---- group: RH_OUT:Mesh_Slabs3
txt_29 = Text(c_script_33)

# ---- group: RH_OUT:Mesh_Slabs4
txt_30 = Text(c_script_34)

# ---- group: RH_OUT:Mesh_Slabs5
txt_31 = Text(c_script_35)

# ---- group: RH_OUT:Mesh_Slabs6
txt_32 = Text(c_script_36)

# ---- group: RH_OUT:Mesh_Slabs8
txt_33 = Text(c_script_37)

# ---- group: RH_OUT:Mesh_Slabs7
txt_34 = Text(c_script_38)

# ---- group: RH_OUT:Mesh_Slabs9
txt_35 = Text(c_script_39)

# ---- group: RH_OUT:Mesh_Slabs10
txt_36 = Text(c_script_40)

# ---- group: RH_OUT:Mesh_Slabs11
txt_37 = Text(c_script_41)

# ---- group: RH_OUT:Mesh_Cores0
txt_38 = Text(c_script_42)

# ---- group: RH_OUT:Mesh_Cores1
txt_39 = Text(c_script_43)

# ---- group: RH_OUT:Mesh_Cores2
txt_40 = Text(c_script_44)

# ---- group: RH_OUT:Mesh_Cores3
txt_41 = Text(c_script_45)

# ---- group: RH_OUT:Mesh_Cores4
txt_42 = Text(c_script_46)

# ---- group: RH_OUT:Mesh_Cores5
txt_43 = Text(c_script_47)

# ---- group: RH_OUT:Mesh_Cores6
txt_44 = Text(c_script_48)

# ---- group: RH_OUT:Mesh_Cores8
txt_45 = Text(c_script_49)

# ---- group: RH_OUT:Mesh_Cores7
txt_46 = Text(c_script_50)

# ---- group: RH_OUT:Mesh_Cores9
txt_47 = Text(c_script_51)

# ---- group: RH_OUT:Mesh_Cores10
txt_48 = Text(c_script_52)

# ---- group: RH_OUT:Mesh_Cores11
txt_49 = Text(c_script_53)

# ---- group: RH_OUT:Mesh_Beams0
txt_50 = Text(c_script_54)

# ---- group: RH_OUT:Mesh_Beams1
txt_51 = Text(c_script_55)

# ---- group: RH_OUT:Mesh_Beams2
txt_52 = Text(c_script_56)

# ---- group: RH_OUT:Mesh_Beams3
txt_53 = Text(c_script_57)

# ---- group: RH_OUT:Mesh_Beams4
txt_54 = Text(c_script_58)

# ---- group: RH_OUT:Mesh_Beams5
txt_55 = Text(c_script_59)

# ---- group: RH_OUT:Mesh_Beams6
txt_56 = Text(c_script_60)

# ---- group: RH_OUT:Mesh_Beams7
txt_57 = Text(c_script_62)

# ---- group: RH_OUT:Mesh_Beams8
txt_58 = Text(c_script_61)

# ---- group: RH_OUT:Mesh_Beams9
txt_59 = Text(c_script_63)

# ---- group: RH_OUT:Mesh_Beams10
txt_60 = Text(c_script_64)

# ---- group: RH_OUT:Mesh_Beams11
txt_61 = Text(c_script_65)
