# Grasshopper definition GD_CRG.gh (Grasshopper 1.0.8)
# plug-ins: KohonenMapper, GH_DesignMate

# ----
# Columns
columns = Geometry([<brep referenced from the Rhino model> x2, <surface referenced from the Rhino model>, <brep referenced from the Rhino model> x10, <surface referenced from the Rhino model>, <brep referenced from the Rhino model> x10, <surface referenced from the Rhino model>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])

# ----
# Slabs
columns_2 = Geometry([<brep referenced from the Rhino model> x11])

debrep = DeconstructBrep(Brep=columns_2)  # -> Faces, Edges, Vertices
pdecon = Deconstruct(Point=debrep.Vertices)  # -> XComponent, YComponent, ZComponent
sort = SortList(Keys=pdecon.ZComponent)  # -> Keys, ValuesA
item = ListItem(List=sort.Keys, Index=0, Wrap=True)
sort_2 = SortList(Keys=flatten(item), ValuesA=columns_2)  # -> Keys, ValuesA
columns_3 = Geometry(simplify(graft(sort_2.ValuesA)))

debrep_2 = DeconstructBrep(Brep=columns)  # -> Faces, Edges, Vertices
pdecon_2 = Deconstruct(Point=debrep_2.Vertices)  # -> XComponent, YComponent, ZComponent
sort_3 = SortList(Keys=pdecon_2.ZComponent)  # -> Keys, ValuesA
item_2 = ListItem(List=sort_3.Keys, Index=0, Wrap=True)
data = Data(flatten(item_2))
cset = CreateSet(List=flatten(item_2))  # -> Set, Map
sort_4 = SortList(Keys=cset.Set)  # -> Keys, ValuesA
similar = Similarity(FirstNumber=graft(sort_4.Keys), SecondNumber=data, Threshold=0.1)  # -> Similarity, AbsoluteDifference
cull = CullPattern(List=columns, CullPattern=similar.Similarity)  # -> simplify(List)

maxheight = Slider(40, range=0..100)

roofgardenbool = Slider(0, range=0..1)
numfloors = Slider(5, range=1..10)
setback = Slider(5, range=0..8)
facadetype = Slider(2, range=0..4)

numfloors_2 = Slider(1, range=1..10)
setback_2 = Slider(1, range=0..8)
facadetype_2 = Slider(0, range=0..4)
roofgardenbool_2 = Slider(0, range=0..1)

roofgardenbool_3 = Slider(1, range=0..1)
numfloors_3 = Slider(3, range=1..10)
setback_3 = Slider(3, range=0..8)
facadetype_3 = Slider(1, range=0..4)

number_slider = Slider(4, range=0..10)

roofgardenbool_4 = Slider(0, range=0..1)
numfloors_4 = Slider(10, range=1..10)
setback_4 = Slider(3, range=0..8)
facadetype_4 = Slider(3, range=0..4)

brep = Brep(<brep referenced from the Rhino model>)
brep_2 = Brep(<brep referenced from the Rhino model>)
brep_3 = Brep(cull)
brep_4 = Brep(columns_3)
brep_5 = Brep(<brep referenced from the Rhino model>)
brep_6 = Brep(<brep referenced from the Rhino model>)

floormaker = CreateFloors(Windows=brep, Walls=brep_2, Columns=brep_3, Slabs=brep_4, Ceilings=brep_6)
c_script = CSharpScript(
    data=[numfloors_2, setback_2, facadetype_2, roofgardenbool_2, numfloors_3, setback_3, facadetype_3, roofgardenbool_3, numfloors, setback, facadetype, roofgardenbool, numfloors_4, setback_4, facadetype_4, roofgardenbool_4],
    numFeatures=Slider(4, range=0..10))  # -> out, a; inputs data: list of Double, numFeatures: Int32
# ---------- c_script: C# ----------
// Grasshopper Script Instance
#region Usings
using System;
using System.Linq;
using System.Collections;
using System.Collections.Generic;
using System.Drawing;

using Rhino;
using Rhino.Geometry;

using Grasshopper;
using Grasshopper.Kernel;
using Grasshopper.Kernel.Data;
using Grasshopper.Kernel.Types;
#endregion

public class Script_Instance : GH_ScriptInstance
{
    #region Notes
    /* 
      Members:
        RhinoDoc RhinoDocument
        GH_Document GrasshopperDocument
        IGH_Component Component
        int Iteration

      Methods (Virtual & overridable):
        Print(string text)
        Print(string format, params object[] args)
        Reflect(object obj)
        Reflect(object obj, string method_name)
    */
    #endregion

    private void RunScript(List<double> data, int numFeatures, ref object a)
    {
        var tree = new DataTree<double>();
        GH_Path path;
        int legge = data.Count / numFeatures;
        int counter = 0;

        for (int i = 0; i < legge; i++)
        {
            path = new GH_Path(i);
            for (int j = 0; j < numFeatures; j++)
            {
                tree.Add(data[counter], path);
                counter++;
            }
        }
        a = tree;
    }
}
# ---------- end c_script ----------

# ---- group: 1. Set to false
toggle = BooleanToggle(False)

# ---- group: check data structure
panel = Panel(c_script.a)

# ---- group: 2. Enable timer
timer = Timer(Interval=20, TimerInterval=20, Target=kohonen_map)  # disabled

# ----
bool = Boolean(roofgardenbool_2)
panel_2 = Panel(bool)
kohonen_map = KohonenMap(
    Reset=toggle,
    XMap=Slider(12, range=0..100),
    YMap=Slider(8, range=0..100),
    Space=Slider(30, range=0..100),
    Inputs=c_script.a,
    WinLearn="0.95",
    Learn="0.9",
    WinLearnDecay="0.999",
    LearnDecay="0.998",
    NeighDecay=0.99,
    NeighRad=Slider(0.6, range=0..1),
    Seed=Slider(61, range=0..100))  # -> Coverged, Counter, Locations, Synaptics, Neigh, InputLocations
pt = Point(kohonen_map.Locations)

# ----
# Facade Type
facade_types = Panel("""Curtain Wall
Cladding Metal
Cladding Timber
Bricks""")
item_3 = ListItem(List=facade_types, Index=Slider(13, range=0..100), Wrap=True)  # -> simplify(Item)

# ----
# Slabs (breps)
geo = Geometry(columns_3)

# ----
# Fl to Fl Height
data_2 = Data(number_slider)

item_4 = ListItem(List=kohonen_map.Synaptics, Index=0, Wrap=True)  # -> Item, Item1, Item2, Item3

# ----
# Columns
geo_2 = Geometry(cull)

round = Round(Number=item_4.Item)  # -> Nearest, Floor, Ceiling
round_2 = Round(Number=item_4.Item1)  # -> Nearest, Floor, Ceiling
round_3 = Round(Number=item_4.Item2)  # -> Nearest, Floor, Ceiling
round_4 = Round(Number=item_4.Item3)  # -> Nearest, Floor, Ceiling
item_5 = ListItem(Index=0, Wrap=True)
generategeomcomp = GenerateGeomComp(
    NumberOfFloors=round.Floor,
    SetbackM=round_2.Floor,
    FacadeType=round_3.Floor,
    AddRoofGarden=round_4.Floor,
    FloorList=floormaker,
    FtF=number_slider,
    MaxHeight=Slider(80, range=0..100))  # -> FacadePlaceholder, Columns, Slabs, Core, Beams
generategeomcomp_2 = GenerateGeomComp(
    NumberOfFloors=round.Floor,
    SetbackM=round_2.Floor,
    FacadeType=round_3.Floor,
    AddRoofGarden=round_4.Floor,
    FloorList=floormaker,
    FtF=number_slider)  # -> Walls, Columns, Slabs, Ceilings, Windows
vec = Vector(kohonen_map.Locations)
brep_7 = Brep([generategeomcomp_2.Walls, generategeomcomp_2.Columns, generategeomcomp_2.Slabs, generategeomcomp_2.Ceilings, generategeomcomp_2.Windows])
panel_3 = Panel(generategeomcomp.Beams)
move = Move(Geometry=brep_7, Motion=vec)  # -> Geometry, Transform
data_3 = Data(item_3)

# ----
# Facade Type
data_4 = Data(data_3)
py3 = Python3Script(x=data_4)  # -> out, a; inputs x: String
# ---------- py3: Python ----------
"""Grasshopper Script"""
a = "Hello Python 3 in Grasshopper!"
if "Curtain Wall" in x:
    a = True
else:
    a = False
# ---------- end py3 ----------
data_5 = Data(py3.a)

# ----
# Facade
geo_3 = Geometry(geo)
debrep_3 = DeconstructBrep(Brep=geo_3)  # -> simplify(Faces), Edges, Vertices
debrep_4 = DeconstructBrep(Brep=debrep_3.Faces)  # -> Faces, simplify(Edges), Vertices
join = JoinCurves(Curves=debrep_4.Edges, Preserve=False)  # -> simplify(Curves)
trim = TrimTree(Tree=join, Depth=1)
crv = Curve(trim)
len = Length(Curve=crv)
sort_5 = SortList(Keys=len, ValuesA=crv)  # -> Keys, ValuesA
item_6 = ListItem(List=reverse(sort_5.ValuesA), Index=[0, 1], Wrap=True)
midpt = CurveMiddle(Curve=item_6)
pdecon_3 = Deconstruct(Point=midpt)  # -> XComponent, YComponent, ZComponent
sort_6 = SortList(Keys=pdecon_3.ZComponent, ValuesA=item_6)  # -> Keys, ValuesA
geo_4 = Geometry(geo_2)
item_7 = ListItem(List=geo_4, Index=0, Wrap=True)
item_8 = ListItem(List=sort_6.ValuesA, Index=0, Wrap=True)
len_2 = Length(Curve=flatten(item_8))
debrep_5 = DeconstructBrep(Brep=item_7)  # -> Faces, Edges, Vertices
explode = Explode(Curve=item_8, Recursive=True)  # -> Segments, Vertices
sort_7 = SortList(Keys=len_2, ValuesA=flatten(item_8))  # -> Keys, ValuesA
len_3 = Length(Curve=debrep_5.Edges)
divlength = DivideLength(Curve=explode.Segments, Length=Slider(5, range=0..10))  # -> Points, Tangents, Parameters
Z = UnitZ(Factor=1)
item_9 = ListItem(List=reverse(sort_7.ValuesA), Index=0, Wrap=True)
sort_8 = SortList(Keys=len_3, ValuesA=debrep_5.Edges)  # -> Keys, ValuesA
data_6 = Data(data_2)
filter = StreamFilter(Gate=data_5, Stream0=Slider(1.5, range=0..10), Stream1=Slider(0.25, range=0..1))
line = LineSDL(Start=divlength.Points, Direction=Z, Length=data_6)
item_10 = ListItem(List=reverse(sort_8.Keys), Index=0, Wrap=True)
explode_2 = Explode(Curve=item_9, Recursive=True)  # -> Segments, Vertices
data_7 = Data(filter)
divlength_2 = DivideLength(Curve=explode_2.Segments, Length=Slider(5, range=0..10))  # -> Points, Tangents, Parameters
rectangle = Rectangle(Plane=PlaneXY(0, 0, 0), XSize=data_7, YSize=data_7, Radius=0)  # -> Rectangle, Length
area = Area(Geometry=rectangle.Rectangle)  # -> Area, Centroid
vec2pt = Vector2Pt(PointA=area.Centroid, PointB=divlength.Points, Unitize=False)  # -> Vector, Length
geo_5 = Geometry(item_8)
geo_6 = Geometry(item_8)
move_2 = Move(Geometry=rectangle.Rectangle, Motion=vec2pt.Vector)  # -> Geometry, Transform
path = ConstructPath(Indices=Slider(5, range=0..100))
data_8 = Data(item_10)
offset = OffsetCurve(Curve=geo_5, Distance=Slider(0.002, range=0..0.01), Corners=1)  # -> simplify(Curve)
trim_2 = TrimTree(Tree=move_2.Geometry, Depth=1)
offset_2 = OffsetCurve(Curve=geo_6, Distance=Slider(0.002, range=0..0.01), Corners=1)  # -> simplify(Curve)
merge = Merge(Data1=geo_5, Data2=offset)
branch = TreeBranch(Tree=simplify(trim_2), Path=path, MaintainPaths=True)
filter_2 = StreamFilter(Gate=data_5, Stream0=Slider(2.3, range=0..10), Stream1=Slider(1.6, range=0..10))
merge_2 = Merge(Data1=geo_6, Data2=offset_2)
loft = Loft(Curves=merge, Options={Adjust=False, Closed=False, LoftEnds=0, LoftSimp=0, LoftType=0, Rebuild=10, Refit=0.01})
Z_2 = UnitZ(Factor=data_8)  # -> simplify(UnitVector)
data_9 = Data(filter_2)
loft_2 = Loft(Curves=merge_2, Options={Adjust=False, Closed=False, LoftEnds=0, LoftSimp=0, LoftType=0, Rebuild=10, Refit=0.01})
Z_3 = UnitZ(Factor=data_9)  # -> simplify(UnitVector)
subtraction = Subtraction(A=data_8, B=data_9)
move_3 = Move(Geometry=loft, Motion=Z_3)  # -> Geometry, Transform
extr = Extrude(Base=trim_2, Direction=Z_2)  # -> simplify(Extrusion)
Z_4 = UnitZ(Factor=subtraction)  # -> simplify(UnitVector)
extr_2 = Extrude(Base=loft_2, Direction=Z_2)
extr_3 = Extrude(Base=loft, Direction=Z_3)
extr_4 = Extrude(Base=move_3.Geometry, Direction=Z_4)
area_2 = Area(Geometry=extr)  # -> Area, Centroid
geo_7 = Geometry(extr_4)
cap = CapHoles(Brep=extr)
scale_nu = ScaleNU(Geometry=extr, Plane=area_2.Centroid, ScaleX=1, ScaleY=1, ScaleZ=Slider(3, range=0..10))  # -> Geometry, Transform
cap_2 = CapHoles(Brep=scale_nu.Geometry)
sdiff = SolidDifference(BrepsA=geo_7, BrepsB=cap_2)

# ----
# solid
geo_8 = Geometry([cap, extr_3])

# ----
# window
geo_9 = Geometry(sdiff)

geo_10 = Geometry(geo_9)
geo_11 = Geometry(geo_8)
filter_3 = StreamFilter(Gate=data_5, Stream0=ColourSwatch(SwatchColor=RGB(184, 156, 123)), Stream1=ColourSwatch(SwatchColor=RGB(186, 186, 186)))
preview = CustomPreview(Geometry=geo_10, Material=ColourSwatch(SwatchColor=RGBA(0, 187, 255, 61)))
data_10 = Data(filter_3)
preview_2 = CustomPreview(Geometry=geo_11, Material=data_10)

geo_12 = Geometry(geo)
geo_13 = Geometry(geo_8)
geo_14 = Geometry(geo_9)
facademaker = CreateFacade(Windows=geo_14, Solid=geo_13, Slabs=geo_12, FacadeType=data_3)
panel_4 = Panel(facademaker)
