# Grasshopper definition structural-analysis.gh (Grasshopper 1.0.7)
# plug-ins: karambaGH

brep = Brep([<brep referenced from the Rhino model> x27])
deconstruct_brep = DeconstructBrep(Brep=brep)  # -> Faces, Edges, Vertices
evaluate_surface = EvaluateSurface(Surface=reparameterize(deconstruct_brep.Faces), Point="0.5,0.5")  # -> Point, Normal, UDirection, VDirection, Frame
brep_2 = Brep([<brep referenced from the Rhino model> x12])
brep_3 = Brep([<brep referenced from the Rhino model> x448])
deconstruct_vector = DeconstructVector(Vector=evaluate_surface.Normal)  # -> XComponent, YComponent, ZComponent
deconstruct_brep_2 = DeconstructBrep(Brep=brep_2)  # -> Faces, Edges, Vertices
deconstruct_brep_3 = DeconstructBrep(Brep=brep_3)  # -> Faces, Edges, Vertices
addition = Addition(A="0", B="0.01")
subtraction = Subtraction(A="0", B="0.01")
evaluate_surface_2 = EvaluateSurface(Surface=reparameterize(deconstruct_brep_2.Faces), Point="0.5,0.5")  # -> Point, Normal, UDirection, VDirection, Frame
evaluate_surface_3 = EvaluateSurface(Surface=reparameterize(deconstruct_brep_3.Faces), Point="0.5,0.5")  # -> Point, Normal, UDirection, VDirection, Frame
larger_than = LargerThan(FirstNumber=deconstruct_vector.ZComponent, SecondNumber=subtraction)  # -> LargerThan, OrEqualTo
smaller_than = SmallerThan(FirstNumber=deconstruct_vector.ZComponent, SecondNumber=addition)  # -> SmallerThan, OrEqualTo
deconstruct = Deconstruct(Point=evaluate_surface_2.Point)  # -> XComponent, YComponent, ZComponent
deconstruct_2 = Deconstruct(Point=evaluate_surface_3.Point)  # -> XComponent, YComponent, ZComponent
sort_list = SortList(Keys=deconstruct.ZComponent, ValuesValuesA=deconstruct_brep_2.Faces)  # -> Keys, ValuesValuesA
gate_and = GateAnd(A=larger_than.LargerThan, B=smaller_than.SmallerThan)
cull_pattern = CullPattern(List=deconstruct_brep.Faces, CullPattern=gate_and)
sort_list_2 = SortList(Keys=deconstruct_2.ZComponent, ValuesValuesA=evaluate_surface_3.Point)  # -> Keys, ValuesValuesA
number_slider = Slider(4, range=0..10)
list_item = ListItem(List=reverse(sort_list.ValuesValuesA), Index=0, Wrap=True)
mesh_breps_karamba3d = MeshBreps(
    Brep=cull_pattern,
    MeshResolution=number_slider,
    EdgeRefinementFactor=0.67,
    PointReduction=False,
    SmoothingStepSize=0,
    SmoothingIterations=5)  # -> Mesh, Info
deconstruct_brep_4 = DeconstructBrep(Brep=cull_pattern)  # -> Faces, Edges, Vertices
list_item_2 = ListItem(List=sort_list_2.ValuesValuesA, Index=0, Wrap=True)
list_item_3 = ListItem(List=reverse(sort_list_2.ValuesValuesA), Index=0, Wrap=True)
line = Line(StartPoint=list_item_3, EndPoint=list_item_2)
deconstruct_3 = Deconstruct(Point=deconstruct_brep_4.Vertices)  # -> XComponent, YComponent, ZComponent
deconstruct_4 = Deconstruct(Point=list_item_2)  # -> XComponent, YComponent, ZComponent
mesh_to_shell_karamba3d = MeshToShellKaramba3D(Mesh=mesh_breps_karamba3d.Mesh, LimitDistance_m=0.005)  # -> Element, Points, Info
material_selection_karamba3d = MaterialSelectionKaramba3D(menu=[dropdown(1), dropdown(2)])
sort_list_3 = SortList(Keys=deconstruct_3.ZComponent, ValuesValuesA=deconstruct_brep_4.Vertices)  # -> Keys, ValuesValuesA
sort_list_4 = SortList(Keys=flatten(deconstruct_4.ZComponent))  # -> Keys, ValuesValuesA
list_item_4 = ListItem(List=sort_list_4.Keys, Index=0, Wrap=True)
element_karamba3d = ElementKaramba3D(flatten(mesh_to_shell_karamba3d.Element))
list_item_5 = ListItem(List=sort_list_3.ValuesValuesA, Index=[0, 1], Wrap=True)
list_item_6 = ListItem(List=reverse(sort_list_3.ValuesValuesA), Index=[0, 1], Wrap=True)
addition_2 = Addition(A=list_item_4, B="0.01")

# ---- group: Define Cross Sections
cross_section_range_selector_karamba3d = CroSecRSelect(
    MaximumHeight_cm=-1,
    MaximumWidth_cm=-1,
    Material=material_selection_karamba3d,
    menu=[dropdown(0), dropdown(1), dropdown(3)])
cross_section_selector_karamba3d = CroSecSelect(CrossSections=cross_section_range_selector_karamba3d, NameOrListIndexOfCrossSection="HEA300")  # -> CrossSection, Info

# ----
smaller_than_2 = SmallerThan(FirstNumber=deconstruct_4.ZComponent, SecondNumber=addition_2)  # -> SmallerThan, OrEqualTo
point = Point(flatten(list_item_6))
cull_pattern_2 = CullPattern(List=list_item_2, CullPattern=smaller_than_2.SmallerThan)
deconstruct_5 = Deconstruct(Point=list_item_5)  # -> XComponent, YComponent, ZComponent
sort_list_5 = SortList(Keys=flatten(deconstruct_5.ZComponent))  # -> Keys, ValuesValuesA
list_item_7 = ListItem(List=sort_list_5.Keys, Index=0, Wrap=True)
addition_3 = Addition(A=list_item_7, B="0.01")
smaller_than_3 = SmallerThan(FirstNumber=deconstruct_5.ZComponent, SecondNumber=addition_3)  # -> SmallerThan, OrEqualTo
cull_pattern_3 = CullPattern(List=list_item_5, CullPattern=smaller_than_3.SmallerThan)
merge = Merge(Data1=cull_pattern_2, Data2=cull_pattern_3)  # -> flatten(Result)
remove_duplicate_points_karamba3d = RemoveDuplicatePointsKaramba3D(Point=merge, LimitDistance=0.005)  # -> OutPoint, Info, Indexes
panel = Panel(merge)
material_selection_karamba3d_2 = MaterialSelectionKaramba3D(menu=[dropdown(3), dropdown(3)])
support_karamba3d = SupportKaramba3D(PosInd=remove_duplicate_points_karamba3d.OutPoint, menu=[buttons(on, on, on, off, off, off)])
merge_2 = Merge(Data1=list_item_3, Data2=point)
mesh_breps_karamba3d_2 = MeshBreps(
    Brep=list_item,
    InclusionPoints=flatten(merge_2),
    MeshResolution=number_slider,
    EdgeRefinementFactor=0.67,
    PointReduction=False,
    SmoothingStepSize=0,
    SmoothingIterations=5)  # -> Mesh, Info
cross_section_karamba3d = CrossSectionKaramba3D(FamilyNameOfCrossSection="DefaultCroSec", Material=material_selection_karamba3d_2, Height_cm="30", mode="Shell - Const")
line_to_beam_karamba3d = LineToBeamKaramba3D(Line=line, CrossSection=cross_section_selector_karamba3d.CrossSection, New=True, Remove=True, LimitDistance_m=0.005)  # -> Element, Points, Info
mesh_to_shell_karamba3d_2 = MeshToShellKaramba3D(Mesh=mesh_breps_karamba3d_2.Mesh, CrossSection=cross_section_karamba3d, LimitDistance_m=0.005)  # -> Element, Points, Info
unit_z = UnitZ(Factor=Slider(-10, range=-100..0))
element_karamba3d_2 = ElementKaramba3D(flatten(line_to_beam_karamba3d.Element))
support_karamba3d_2 = SupportKaramba3D(flatten(support_karamba3d))
element_karamba3d_3 = ElementKaramba3D(flatten(mesh_to_shell_karamba3d_2.Element))
loads_karamba3d = LoadsKaramba3D(Vector=unit_z, LCase=0, mode="Gravity")
merge_3 = Merge(Data1=element_karamba3d_3, Data2=element_karamba3d_2, Data3=element_karamba3d)
assemble_model_karamba3d = AssembleModelKaramba3D(Elem=merge_3, Support=support_karamba3d_2, Load=loads_karamba3d, LimitDistance_m=0.005)  # -> Model, Info, Mass_kg, CenterOfGravity
eigen_modes_karamba3d = EigenModesKaramba3D(Model=assemble_model_karamba3d.Model, FromIndex=1, NumberOfModes=1, MaximumNumberOfIterations=300, Epsilon=1e-07)  # -> ModelWithEigenModesAsLoadCaseResults, Eigenvalues
connected_parts_karamba3d = ConnectedPartsKaramba3D(Model=assemble_model_karamba3d.Model)  # -> ConnectedLines, ConnectedMeshes
analyze_karamba3d = AnalyzeKaramba3D(Model=assemble_model_karamba3d.Model)  # -> CalculatedModel, MaximumDisplacement_cm, ResultingForceOfGravity_kN, ElasticEnergy_kNm
tree_branch = TreeBranch(Tree=connected_parts_karamba3d.ConnectedLines, Path="{0;0}", MaintainPaths=True)
panel_2 = Panel(eigen_modes_karamba3d.Eigenvalues)
model_view_karamba3d = ModelViewKaramba3D(Model=analyze_karamba3d.CalculatedModel, ResultFactors=1, ResultCase=-1)  # -> Model, DeformedMesh, DeformedAxes, DeformedModel
model_view_karamba3d_2 = ModelViewKaramba3D(Model=analyze_karamba3d.CalculatedModel, ResultFactors=1, ResultCase=-1)  # -> Model, DeformedMesh, DeformedAxes, DeformedModel
shell_view_karamba3d = ShellViewKaramba3D(Model=model_view_karamba3d_2.Model, IndexOfLayer=0)  # -> Model, MeshesOfRenderedShells, LegendColors, LegendTags
beam_view_karamba3d = BeamViewKaramba3D(Model=model_view_karamba3d.Model)  # -> Model, MeshesOfRenderedBeams, DeformedBeamAxes, LegendColors, LegendTags
legend = Legend(Colour=beam_view_karamba3d.LegendColors, Tags=beam_view_karamba3d.LegendTags, LegendType=1)  # disabled
beam_forces_karamba3d = BeamForcesKaramba3D(
    AnalyzedModel=analyze_karamba3d.CalculatedModel,
    LCase=-1,
    MaximumDistanceBetweenResults_m=-1,
    NumberOfResultsPerBeamElement=2)  # -> AnalyzedModel, NormalForce_kN, ShearForceVz_kN, ShearForceVy_kN, BendingMomentMt_kNm, BendingMomentMy_kNm, BendingMomentMz_kNm; disabled
result_vectors_on_shells_karamba3d = ResultVectorsOnShellsKaramba3D(AnalyzedModel=analyze_karamba3d.CalculatedModel, LayerPosition=0, mode="PrincStress")  # -> AnalyzedModel, Points, FirstPrincipalStressVector_kN_cm2, SecondPrincipalStressVector_kN_cm2, FirstPrincipalStressValue_kN_cm2, SecondPrincipalStressValue_kN_cm2; disabled
mesh = Mesh(beam_view_karamba3d.MeshesOfRenderedBeams)
legend_2 = Legend(Colour=shell_view_karamba3d.LegendColors, Tags=shell_view_karamba3d.LegendTags, LegendType=101)
mesh_2 = Mesh(shell_view_karamba3d.MeshesOfRenderedShells)
panel_3 = Panel("-1")  # disabled
panel_4 = Panel("100")  # disabled
multiplication = Multiplication(A=panel_4, B=panel_3)  # disabled
panel_5 = Panel("20000")  # disabled
panel_6 = Panel("-1")  # disabled
smaller_than_4 = SmallerThan(FirstNumber=result_vectors_on_shells_karamba3d.SecondPrincipalStressValue_kN_cm2, SecondNumber=panel_4)  # -> SmallerThan, OrEqualTo; disabled
larger_than_2 = LargerThan(FirstNumber=result_vectors_on_shells_karamba3d.SecondPrincipalStressValue_kN_cm2, SecondNumber=multiplication)  # -> LargerThan, OrEqualTo; disabled
multiplication_2 = Multiplication(A=panel_5, B=panel_6)  # disabled
smaller_than_5 = SmallerThan(FirstNumber=beam_forces_karamba3d.NormalForce_kN, SecondNumber=panel_5)  # -> SmallerThan, OrEqualTo; disabled
larger_than_3 = LargerThan(FirstNumber=beam_forces_karamba3d.NormalForce_kN, SecondNumber=multiplication_2)  # -> LargerThan, OrEqualTo; disabled
merge_4 = Merge(Data1=list_item, Data2=cull_pattern)  # disabled
gate_and_2 = GateAnd(A=smaller_than_4.SmallerThan, B=larger_than_2.LargerThan)  # disabled
gate_and_3 = GateAnd(A=smaller_than_5.SmallerThan, B=larger_than_3.LargerThan)  # disabled
cull_pattern_4 = CullPattern(List=merge_4, CullPattern=reverse(gate_and_2))  # disabled
cull_pattern_5 = CullPattern(List=merge_4, CullPattern=gate_and_2)  # disabled

# ----
# Failed Columns
cull_pattern_6 = CullPattern(List=line, CullPattern=invert(gate_and_3))  # disabled

# ----
# Columns that's oke
cull_pattern_7 = CullPattern(List=line, CullPattern=gate_and_3)  # disabled
